# Dynamo graph 001_КопированиеЛистов.dyn "036_ПереносЗначенияПараметраВоВложеноеСемейство" (Dynamo 2.6.1.8786)

# group: Путь до скрипта
путь_до_python_скрипта = StringInput("Y:\!00_RevitFileServer\99_BIM-Database\080_Dynamo\001_КопированиеЛистов\copy_sheet\main.py")
file_from_path = FileObject(path=путь_до_python_скрипта)
readText = FileSystem.ReadText(file=file_from_path)

нужно_ли_копировать_планы = BoolSelector(true)  # "Нужно ли копировать планы расположенные на листе"
повторятор = BoolSelector(true)
python_script_from_string = PythonStringNode(script=readText, IN[0]=нужно_ли_копировать_планы, IN[1]=повторятор)
