# Dynamo graph 031_ПодсчетОбъемов3DЭлементовРевит.dyn (Dynamo 2.6.1.8786)

# group: Путь до скрипта
путь_до_python_скрипта = StringInput("Y:\!00_RevitFileServer\99_BIM-Database\080_Dynamo\031_ПодсчетОбъемов3DЭлементовРевит\GetGeometry\main.py")
file_from_path = FileObject(path=путь_до_python_скрипта)
readText = FileSystem.ReadText(file=file_from_path)

имя_параметра_подсчета_объема = StringInput("ADSK_Размер_Объем")
повторитьСкрипт = BoolSelector(false)
python_script_from_string = PythonStringNode(script=readText, IN[0]=имя_параметра_подсчета_объема, IN[1]=повторитьСкрипт)
