# Dynamo graph 025_ИзмыПодсчет.dyn (Dynamo 2.6.1.8786)

путь_моидокументы = Python()  # unwired: IN[0]
# ---------- путь_моидокументы.python (12 lines) ----------
import os

user_docs = os.path.join(os.path.join(os.environ['USERPROFILE']), 'Documents')

def create_csv_analysis_file():
    file = open(
        os.path.join(user_docs, 'DYNAMO_AnalysisSheet.csv'),
        'w+')
    file.close()


OUT = os.path.join(user_docs, 'DYNAMO_AnalysisSheet.csv')
# ----------------------------------------

# group: Путь до скрипта
string = StringInput("{Впишите путь до исполняемого скрпипта}")
file_from_path = FileObject(path=string)
readText = FileSystem.ReadText(file=file_from_path)

имя_семейства_аннотации = StringInput("0021_ТаблицаИзменений_АР0.К_R21(ТипАннотации)")
имя_параметра_листа_куда_будет = StringInput("АР_Содержание_изм_скрипт")  # "Имя параметра листа куда будет записаны комментарии облака"
анализ_размещенных_измов_на = BoolSelector(true)  # "Анализ размещенных измов на листе"
повторятор = BoolSelector(true)
python_script_from_string = PythonStringNode(script=readText, IN[0]=имя_семейства_аннотации, IN[1]=имя_параметра_листа_куда_будет, IN[2]=анализ_размещенных_измов_на, IN[3]=повторятор)
exportCSV = Data.ExportCSV(filePath=путь_моидокументы, data=python_script_from_string)
