# Dynamo graph 003_Подсчет отделки помещений.dyn (Dynamo 2.6.1.8786)

# group: Путь до скрипта
путь_до_python_скрипта = StringInput("{Путь до исполняемого файла}")
file_from_path = FileObject(path=путь_до_python_скрипта)
readText = FileSystem.ReadText(file=file_from_path)

# group: Входные данные
нужно_записывать_параметры = BoolSelector(true)  # "Нужно записывать параметры помещения в отделку?"; graph input
нужно_выравнивать_значения = BoolSelector(true)  # "Нужно выравнивать значения параметров между полями, относительно самого большого значения параметров?"; graph input

# group: Путь до файла эксель
путь_до_файла_excel = StringInput("{Путь до файла Excel}")
file_from_path_2 = FileObject(path=путь_до_файла_excel)

boolean = BoolSelector(false)

# group: Лист имен спецификаций
имя_листа = StringInput("Имена спецификаций")
importExcel = Data.ImportExcel(file=file_from_path_2, sheetName=имя_листа, showExcel=boolean)

# group: Имена параметров стен
имя_листа_2 = StringInput(" Отделка стен")
importExcel_2 = Data.ImportExcel(file=file_from_path_2, sheetName=имя_листа_2, showExcel=boolean)

# group: Имена параметров полов
имя_листа_3 = StringInput("Отделка полов")
importExcel_3 = Data.ImportExcel(file=file_from_path_2, sheetName=имя_листа_3, showExcel=boolean)

# group: Имена параметров потолков
имя_листа_4 = StringInput("Отделка потолков")
importExcel_4 = Data.ImportExcel(file=file_from_path_2, sheetName=имя_листа_4, showExcel=boolean)

# group: Имена параметров Плинтусов
имя_листа_5 = StringInput("Плинтусы")
importExcel_5 = Data.ImportExcel(file=file_from_path_2, sheetName=имя_листа_5, showExcel=boolean)

# group: Параметры элементов отделки
имя_листа_6 = StringInput("Параметры элементов отделки")
importExcel_6 = Data.ImportExcel(file=file_from_path_2, sheetName=имя_листа_6, showExcel=boolean)

boolean_2 = BoolSelector(true)
python_script_from_string = PythonStringNode(script=readText, IN[0]=нужно_записывать_параметры, IN[1]=нужно_выравнивать_значения, IN[2]=importExcel, IN[3]=importExcel_2, IN[4]=importExcel_3, IN[5]=importExcel_4, IN[6]=importExcel_5, IN[7]=importExcel_6, IN[8]=boolean_2)
