# Dynamo graph 027_ИсправлениеКоллизийСЛестницами.dyn (Dynamo 2.6.1.8786)

# group: Путь до скрипта
путь_до_python_скрипта = StringInput("C:\dynamo_projects\dynamo_cut_geom_stairs\cut_geom_stairs\main.py")
file_from_path = FileObject(path=путь_до_python_скрипта)
readText = FileSystem.ReadText(file=file_from_path)

категории_исключения = Categories("OST_Ceilings")  # graph input
повторитьСкрипт = BoolSelector(true)
python_script_from_string = PythonStringNode(script=readText, IN[0]=путь_до_python_скрипта, IN[1]=категории_исключения, IN[2]=повторитьСкрипт)
