# Dynamo graph 035_ИзменениеКатегориСпецификации.dyn (Dynamo 2.6.1.8786)

# group: Путь до скрипта
путь_до_python_скрипта = StringInput("{Путь до исполняемого файла main.py}")
file_from_path = FileObject(path=путь_до_python_скрипта)
readText = FileSystem.ReadText(file=file_from_path)

категория = Categories("OST_Ceilings")  # graph input
повторитьСкрипт = BoolSelector(false)
python_script_from_string = PythonStringNode(script=readText, IN[0]=категория, IN[1]=повторитьСкрипт)
