# Dynamo graph 036_ПереносЗначенияПараметраВоВложеноеСемейство.dyn (Dynamo 2.6.1.8786)

# group: Путь до скрипта
путь_до_python_скрипта = StringInput("Y:\!00_RevitFileServer\99_BIM-Database\080_Dynamo\036_ПереносЗначенияПараметраВоВложеноеСемейство\transfer_value_par_in_nest_family\main.py")
file_from_path = FileObject(path=путь_до_python_скрипта)
readText = FileSystem.ReadText(file=file_from_path)

параметр_из_которого_берется = StringInput("Марка")  # "Параметр из которого берется значение"
параметр_куда_берутся_значения = StringInput("ADSK_Группирование")
повторитьСкрипт = BoolSelector(false)
python_script_from_string = PythonStringNode(script=readText, IN[0]=параметр_из_которого_берется, IN[1]=параметр_куда_берутся_значения, IN[2]=повторитьСкрипт)
