# Dynamo graph 026_СоединениеВыбранныхСтенПодУглом.dyn (Dynamo 2.6.1.8786)

python_script = Python()  # unwired: IN[0]
# ---------- python_script.python (49 lines) ----------
import clr
clr.AddReference("RevitAPI")
from Autodesk.Revit import DB
clr.AddReference('RevitServices')
from RevitServices.Persistence import DocumentManager


TRANSACTION_NAME = (
    'DYNAMO Соединение выбранных стен под углом.'
)


uiapp = DocumentManager.Instance.CurrentUIApplication
doc = DocumentManager.Instance.CurrentDBDocument
app = uiapp.Application
uidoc = uiapp.ActiveUIDocument


class SelectException(Exception):
    pass


def check_selection_element(select_el):
    except_message = 'Выберите хотя бы одну стену.'
    if not select_el:
        raise SelectException(except_message)


def set_miter_walls(walls):
    """
    Mitter compound for walls
    """
    with DB.Transaction(doc, TRANSACTION_NAME) as t:
        t.Start()
        for wall in walls:
            location_curve = wall.Location
            location_curve.JoinType[1] = DB.JoinType.Miter
            location_curve.JoinType[0] = DB.JoinType.Miter
        t.Commit()


selection_wall = set_miter_walls([
    doc.GetElement(el_id) for el_id in uidoc.Selection.GetElementIds()
    if isinstance(doc.GetElement(el_id), DB.Wall)
])

check_selection_element(selection_wall)

OUT = 'Соединено {}'.format(str(len(selection_wall)))
# ----------------------------------------
